# Dynamo graph Wall Protection Automation_RVT21_dynamo player.dyn (Dynamo 2.6.1.8786)
# packages: Clockwork for Dynamo 2.x 2.3.0, archi-lab.net 2022.212.2722, Flackage 2.6.0

# note: This color system should be used for most dynamo graphs. If you would like to change the colors for some reason please update the notes below.  Use the saturated colors to help those with visual impairments

# group: WIP
# note: Notes not considered part of the final package

# group: DEBUG
# note: Nodes used to debug the graph logic

# group: CREATION
# note: Dynamo objects or data created inside of dynamo

# group: SET
# note: Set parameter values of Revit/Formit objects

# group: USER INPUT
# note: Object creation in Revit or Data output for Generative Design

# group: INPUT
# note: Data input and preparation

# group: OUTPUT
# note: Object creation in Revit or Data output for Generative Design

# group: GET
# note: Get parameter values from Revit/Formit objects

# group: FUNCTION
# note: Data manipulation on dynamo objects

# group: Wall Protection and Signage Automation
# note: DESCRIPTION
# Please describe as much as possible about the dynamo graph to ensure clarity and reduce startup time if the graph must be edited/updated
# note: INSTRUCTIONS
# 1) Decide if you are going to use the room functioned parameter to select the WPS Family type or select elements manually.
# 2) Be sure you are in a desired view and on the correct workset.  If you forsee running this graph multiple times an additional workset can be helpful.
# 3) Select the correct revit elements from your model and choose a family type to associate with the "room function" parameter or your selection.
# 4) Run the graph and grab a coffee
# note: INPUTS
# Dictionary used for Room Functions
# OUPUT
# Dictionary outputs WSP type
# note: GUIDELINES
# Read the instructions.
# Add Notes (Ctrl + W) and Comments to the graph.
# Use the Cleanup Node Layout command (Ctrl + L) on the graph and inside Groups to enhance legibility.
# Use Node Groups and the Standard Color Coding.
# Rename Nodes: <OriginalName> || <Description>.
# note: PACKAGES
# Flackage 2.6, Clockwork 2.3.0, and Archi-lab.net 2022.212.2722
# note: NOTES
# Please reach out to the F(x) team if you would like to use the Room Function Parameter
# note: KNOWN ISSUES
# 1) Casework can cause issues if it is not orthogonal
# note: AUTHOR DATE and/or PROJECT
# 04/12/2022
# This Graph has been edited and updated for Flad with parts of a base graph from Bill Carney
# https://www.autodesk.com/autodesk-university/class/Revit-and-Dynamo-Interior-Design-2017
# contact Andrew Heilman if this graph is broken

# group: Select Rooms
select_rooms = DSModelElementsByCategorySelection(index=468)  # 1 picked in the model; graph input

process_Room_Boundaries = Custom[Process_Room_Boundaries](Rooms=select_rooms)  # package Flackage; Collects the inside and outside boundary of a room

# group: Selects current view
current = Document.Current()
activeView = Document.ActiveView(document=current)

# group: Misc Geometry
boolean = BoolSelector(true)
# note: Custom Node: Clockwork Package
insertsOfBoundaries = Custom[Room.InsertsOfBoundaries](room=select_rooms, includeOpenings=boolean, includeEmbeddedWalls=boolean, includeSharedEmbeddedInserts=boolean)  # package Clockwork for Dynamo 2.x; Retrieves the inserts of the bounding elements of a given room.
flatten = List.Flatten(list=insertsOfBoundaries)
uniqueItems = List.UniqueItems(list=flatten)
solids = Element.Solids(element=uniqueItems)

# group: Door Geometry
categories = Categories("OST_Doors")
boolean_2 = BoolSelector(false)
clean = List.Clean(list=solids, preserveIndices=boolean_2)

all_elements_of_category_in_view = ElementsOfCategoryInView(Category=categories, View=activeView)

# group (continued): Door Geometry
solids_2 = Element.Solids(element=all_elements_of_category_in_view)
flatten_2 = List.Flatten(list=solids_2)
clean_2 = List.Clean(list=flatten_2, preserveIndices=boolean_2)

# group: Select Casework
select_casework = DSModelElementsByCategorySelection(index=129)  # 4 picked in the model; graph input

# group: Casework Geometry
solids_3 = Element.Solids(element=select_casework)
byUnion = Solid.ByUnion(solids=solids_3@L2)
clean_3 = List.Clean(list=byUnion, preserveIndices=boolean_2)
byGeometry = BoundingBox.ByGeometry(geom=clean_3@L1)
toCuboid = BoundingBox.ToCuboid(boundingBox=byGeometry)
centroid = Solid.Centroid(solid=toCuboid)
byOrigin = CoordinateSystem.ByOrigin(origin=centroid)
width = Cuboid.Width(cuboid=toCuboid)
length = Cuboid.Length(cuboid=toCuboid)
byWidthLength = Rectangle.ByWidthLength(cs=byOrigin, width=width, length=length)
casework_expansion_for_cut = CodeBlock { 0.25; 6; }
offset = Curve.Offset(curve=byWidthLength, distance=casework_expansion_for_cut.out0)
extrudeAsSolid = Curve.ExtrudeAsSolid(curve=offset, distance=casework_expansion_for_cut.out1)

# group: Cutting Geometry
join = List.Join(list0=clean_2, list1=clean, list2=extrudeAsSolid)
byUnion_2 = Solid.ByUnion(solids=join)

# group: Process Lines
watch = Watch(process_Room_Boundaries.OutsidePolyCurve)
curves = PolyCurve.Curves(polyCurve=watch)
curveLoop_Simplify = Custom[CurveLoop_Simplify](curveLoop=curves)  # package Flackage; Simplify open or closed curve loops combining straight set of lines into a longer single curve

# group: Offset Lines
code_block = CodeBlock { 4; }
byCoordinates = Vector.ByCoordinates(z=code_block)
translate = Geometry.Translate(geometry=curveLoop_Simplify, direction=byCoordinates)

# group: Convert Wall Geometry
uniqueItems_2 = List.UniqueItems(list=process_Room_Boundaries.Elements@L2)
solids_4 = Element.Solids(element=uniqueItems_2)
flatten_3 = List.Flatten(list=solids_4@L3)
byUnion_3 = Solid.ByUnion(solids=flatten_3@L2, lacing=Longest)

# group: Insert Casework
difference = Solid.Difference(solid=byUnion_3, other=byUnion_2)

# group (continued): Convert Wall Geometry
intersect = Geometry.Intersect(geometry=difference, other=translate@L2, lacing=Longest)

# group: Minimum Length of WPS
minimum_wpx_or_hrx_length = LengthFromString(Value=0.3048)  # graph input

# group: Set Minimum Length of Family
flatten_4 = List.Flatten(list=intersect@L3)
length_2 = Curve.Length(curve=flatten_4)
isNull = Object.IsNull(obj=length_2)
filterByBoolMask = List.FilterByBoolMask(list=flatten_4, mask=isNull)
filterByBoolMask_2 = List.FilterByBoolMask(list=length_2, mask=isNull)
ge = filterByBoolMask_2.out >= minimum_wpx_or_hrx_length
filterByBoolMask_3 = List.FilterByBoolMask(list=filterByBoolMask.out, mask=ge)

# group: Use Room Function Parameter
boolean_3 = BoolSelector(false)  # graph input

# group: Room Function Parameters in use
room_function_parameters = CodeBlock { ["Building Support","Circulation","Collaboration","Infusion Bay","Lobby","Lobby Support","Office Space","Office Support","Open Office","Patient Support/Diagnostic Spaces","Prep Recovery","Procedure","Reception - Education","Staff Support Spaces","Team Station","Telehealth","Universal Treatment"]; }

# group: Room Function WPS
building_support_wps = FamilyTypes("F-Wall_Protection_System-WPS:FRP-X - FRP PANEL (4'-4\" AFF)")
circulation_wps = FamilyTypes("F-Wall_Protection_System-WPS:WPS-3 - HAND RAIL+CRASH RAIL+SHEET")
collaboration_wps = FamilyTypes("F-Wall_Protection_System-WPS:SP-X - SHEET WALL PROT - 28\" AFF (under window-low)")
infusion_bay_wps = FamilyTypes("F-Wall_Protection_System-WPS:WPS-9 - HANDRAIL + CRASHRAIL")
lobby_wps = FamilyTypes("F-Wall_Protection_System-WPS:SSM-X - SOLID SURFACE WALL PANEL - 7'-2\" AFF")
lobby_support_wps = FamilyTypes("F-Wall_Protection_System-WPS:SP-X - SHEET WALL PROT - 9'-0\" AFF")
office_space_wps = FamilyTypes("F-Wall_Protection_System-WPS:SP-X - SHEET WALL PROT - 4'-6\" AFF")
office_support_wps = FamilyTypes("F-Wall_Protection_System-WPS:SP-X - SHEET WALL PROT - 9'-0\" AFF")
open_office_wps = FamilyTypes("F-Wall_Protection_System-WPS:SP-X - SHEET WALL PROT - 4'-6\" AFF")
patient_support_diagnostic = FamilyTypes("F-Wall_Protection_System-WPS:SP-X - SHEET WALL PROT - 4'-6\" AFF")  # "Patient Support/Diagnostic Spaces WPS"
prep_recovery_wps = FamilyTypes("F-Wall_Protection_System-WPS:WPS-4 - DOUBLE CRASH RAIL+SHEET")
procedure_wps = FamilyTypes("F-Wall_Protection_System-WPS:WPS-4 - DOUBLE CRASH RAIL+SHEET - 5'-6\" AFF")
reception_education_wps = FamilyTypes("F-Wall_Protection_System-WPS:SSM-X - SOLID SURFACE WALL PANEL - 8'-6\" AFF")
staff_support_spaces_wps = FamilyTypes("F-Wall_Protection_System-WPS:SP-X - SHEET WALL PROT - 4'-6\" AFF")
team_station_wps = FamilyTypes("F-Wall_Protection_System-WPS:SP-X - SHEET WALL PROT - 40\" AFF")
telehealth_wps = FamilyTypes("F-Wall_Protection_System-WPS:SP-X - SHEET WALL PROT - 36\" AFF (under window)")
universal_treatment_wps = FamilyTypes("F-Wall_Protection_System-WPS:WPS-1 - SHEET WALL PROT - 4'-0\" AFF")

name = Family.Name(family=building_support_wps)
name_2 = Family.Name(family=circulation_wps)
name_3 = Family.Name(family=collaboration_wps)
name_4 = Family.Name(family=infusion_bay_wps)
name_5 = Family.Name(family=lobby_wps)
name_6 = Family.Name(family=lobby_support_wps)
name_7 = Family.Name(family=office_space_wps)
name_8 = Family.Name(family=office_support_wps)
name_9 = Family.Name(family=open_office_wps)
name_10 = Family.Name(family=patient_support_diagnostic)
name_11 = Family.Name(family=prep_recovery_wps)
name_12 = Family.Name(family=procedure_wps)
name_13 = Family.Name(family=reception_education_wps)
name_14 = Family.Name(family=staff_support_spaces_wps)
name_15 = Family.Name(family=team_station_wps)
name_16 = Family.Name(family=telehealth_wps)
name_17 = Family.Name(family=universal_treatment_wps)
list_create = List.Create(item0=name, item1=name_2, item2=name_3, item3=name_4, item4=name_5, item5=name_6, item6=name_7, item7=name_8, item8=name_9, item9=name_10, item10=name_11, item11=name_12, item12=name_13, item13=name_14, item14=name_15, item15=name_16, item16=name_17)
byKeysValues = DesignScript.Builtin.Dictionary.ByKeysValues(keys=room_function_parameters, values=list_create)

# group: Wall Protection Family
wps_x_for_manual_selection = FamilyTypes("F-Wall_Protection_System-WPS:WPS-3 - HAND RAIL+CRASH RAIL+SHEET")  # graph input

# group: Get Room Wall Protection
code_block_2 = CodeBlock { "Room Function"; }
getParameterValueByName = Element.GetParameterValueByName(element=select_rooms, parameterName=code_block_2)
valueAtKey = DesignScript.Builtin.Dictionary.ValueAtKey(dictionary=byKeysValues, key=getParameterValueByName)
byName = FamilyType.ByName(name=valueAtKey)
name_18 = Family.Name(family=wps_x_for_manual_selection)
watch_2 = Watch(name_18)
byName_2 = FamilyType.ByName(name=watch_2)
if_ = If(test=boolean_3, true=byName, false=byName_2)
code_block_3 = CodeBlock { ","; }

# group: Get Room Level
code_block_4 = CodeBlock { "Level"; }
getParameterValueByName_2 = Element.GetParameterValueByName(element=select_rooms, parameterName=code_block_4)
# note: Custom Node: Archi-Lab Package
getLevelByName = archilab.Revit.Selection.Select.GetLevelByName(name=getParameterValueByName_2)

# group: Place Family
# note: Custom Node: Clockwork Package
byCurve = Custom[FamilyInstance.ByCurve](curve=filterByBoolMask_3.in, familyType=if_, level=getLevelByName, lacing=Longest)  # package Clockwork for Dynamo 2.x; Places a line-based family instance on a given level

# group: Process Lines
watch_3 = Watch(process_Room_Boundaries.InsidePolyCurve)
curves_2 = PolyCurve.Curves(polyCurve=watch_3)
curveLoop_Simplify_2 = Custom[CurveLoop_Simplify](curveLoop=curves_2)

# group: Offset Lines
code_block_5 = CodeBlock { 4; }
byCoordinates_2 = Vector.ByCoordinates(z=code_block_5)
translate_2 = Geometry.Translate(geometry=curveLoop_Simplify_2, direction=byCoordinates_2)

# group: Convert Wall Geometry
intersect_2 = Geometry.Intersect(geometry=difference, other=translate_2@L2, lacing=Longest)

# group: Set Minimum Length of Family
flatten_5 = List.Flatten(list=intersect_2@L3)
length_3 = Curve.Length(curve=flatten_5)
isNull_2 = Object.IsNull(obj=length_3)
filterByBoolMask_4 = List.FilterByBoolMask(list=flatten_5, mask=isNull_2)
filterByBoolMask_5 = List.FilterByBoolMask(list=length_3, mask=isNull_2)
ge_2 = filterByBoolMask_5.out >= minimum_wpx_or_hrx_length
filterByBoolMask_6 = List.FilterByBoolMask(list=filterByBoolMask_4.out, mask=ge_2)

# group: Place Family
# note: Custom Node: Clockwork Package
byCurve_2 = Custom[FamilyInstance.ByCurve](curve=filterByBoolMask_6.in, familyType=if_, level=getLevelByName, lacing=Longest)

# group: Corner Guard Family
f_corner_guard_x = FamilyTypes("F-Corner Guard:CG1 - FULL HT CORNER GUARD")  # graph input

# group: Combine Inside and Outside Nodes
list_create_2 = List.Create(item0=process_Room_Boundaries.OutsidePolyCurve, item1=process_Room_Boundaries.InsidePolyCurve)
flatten_6 = List.Flatten(list=list_create_2)

# group: Simplify Curves
curves_3 = PolyCurve.Curves(polyCurve=flatten_6)
curveLoop_Simplify_3 = Custom[CurveLoop_Simplify](curveLoop=curves_3)

# group: Convert Room Boundary to Vector
endPoint = Curve.EndPoint(curve=curveLoop_Simplify_3)
startPoint = Curve.StartPoint(curve=curveLoop_Simplify_3)
byTwoPoints = Vector.ByTwoPoints(start=startPoint, end=endPoint)

# group: Find Angles that receive Corner Guards
code_block_6 = CodeBlock { -1; }
shiftIndices = List.ShiftIndices(list=byTwoPoints@L2, amount=code_block_6, lacing=Longest)
ZAxis = Vector.ZAxis()
angleAboutAxis = Vector.AngleAboutAxis(vector=shiftIndices, otherVector=byTwoPoints, rotationAxis=ZAxis, lacing=Longest)
watch_4 = Watch(angleAboutAxis)
round = Math.Round(number=watch_4)
angleWithVector = Vector.AngleWithVector(vector=byTwoPoints, otherVector=shiftIndices)
watch_5 = Watch(angleWithVector)
round_2 = Math.Round(number=watch_5)
sub = round - round_2

# group: Get List of Placement Points
code_block_7 = CodeBlock { 135; }
lt = sub < code_block_7
boolean_4 = BoolSelector(true)
allIndicesOf = List.AllIndicesOf(list=lt@L2, item=boolean_4)
getItemAtIndex = List.GetItemAtIndex(list=endPoint@L2, index=allIndicesOf, lacing=Longest)

# group: Find Rotation Angle of Corner Guard
YAxis = Vector.YAxis()
ZAxis_2 = Vector.ZAxis()
angleAboutAxis_2 = Vector.AngleAboutAxis(vector=byTwoPoints, otherVector=YAxis, rotationAxis=ZAxis_2, lacing=Longest)
round_3 = Math.Round(number=angleAboutAxis_2)

# group: Get list of Angles and update for rotation of family
getItemAtIndex_2 = List.GetItemAtIndex(list=round_3@L2, index=allIndicesOf, lacing=Longest)
code_block_8 = CodeBlock { 90; }
add = getItemAtIndex_2 + code_block_8

# group: Place Corner Guard Family & Set Rotation
byPoint = FamilyInstance.ByPoint(familyType=f_corner_guard_x, point=getItemAtIndex)
setRotation = FamilyInstance.SetRotation(familyInstance=byPoint, degree=add)

isNull_3 = Object.IsNull(obj=flatten_6)
filterByBoolMask_7 = List.FilterByBoolMask(list=flatten_6, mask=isNull_3)
curves_4 = PolyCurve.Curves(polyCurve=filterByBoolMask_7.out)
